# Grasshopper definition 2_drumMachine.gh (Grasshopper 1.0.7)
# plug-ins: Siren

number_slider = Slider(120, range=0..1000)
number_slider_2 = Slider(10, range=10..100)
number_slider_3 = Slider(3, range=0..10)
number_slider_4 = Slider(0, range=0..1)
xy = XYPlane(Origin=Point(0, 0, 0))
crv = Curve(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)
python = GhPythonScript(tempo=number_slider, division="1/4", T=number_slider_2, duration=number_slider_3, offset=number_slider_4)  # -> beats
# ---------- python: Python ----------
__author__ = "alasd"
__version__ = "2021.10.02"

from Rhino import Geometry as g

div_length = (tempo/60) * division * T

beats = [g.Point3d(offset*div_length, 0,0)]
if div_length > 0:
    elapsedTime = offset*div_length
    while elapsedTime < duration * T:
        elapsedTime += div_length
        point = g.Point3d(elapsedTime, 0,0)
        beats.append(point)
# ---------- end python ----------
python_2 = GhPythonScript(tempo=number_slider, division="3/16", T=number_slider_2, duration=number_slider_3, offset=number_slider_4)  # -> beats; same code as python
python_3 = GhPythonScript(tempo=number_slider, division="1/2", T=number_slider_2, duration=number_slider_3, offset=Slider(0, range=0..1))  # -> beats; same code as python
python_4 = GhPythonScript(tempo=number_slider, division="1/2", T=number_slider_2, duration=number_slider_3, offset=Slider(0.5, range=0..1))  # -> beats; same code as python
nickname = CVComponent(
    Curve=crv,
    Plane=xy,
    TimeFactor=number_slider_2,
    AmplitudeFactor=Slider(10, range=0..10),
    SampleRate=Slider(100, range=0..100))  # -> Wave, Trigger
nickname_2 = NoiseComponent(Duration=Slider(1, range=0..1), wavetype="White")
merge = Merge(Data1=python, Data2=python_2)
nickname_3 = VCAComponent(Wave=nickname_2, Amplitude=nickname.Wave)
python_5 = GhPythonScript(file_name="CH.wav")  # -> output_path
# ---------- python_5: Python ----------
import os

script_path = ghenv.Component.OnPingDocument().FilePath
script_folder = os.path.dirname(script_path)
output_path = os.path.join(script_folder, file_name)
# ---------- end python_5 ----------
python_6 = GhPythonScript(file_name="BD.wav")  # -> output_path; same code as python_5
# README: This assumes that the sample .wav files are located in the same directory as this definition. If you just downloaded the definition, the samples can be  downloaded at https://github.com/AlasdairMott/Siren/tree/develop/examples and referenced using standard File Path components.
python_7 = GhPythonScript(file_name="SD.wav")  # -> output_path; same code as python_5
nickname_4 = ReadSampleComponent(Path=python_5)
nickname_5 = ReadSampleComponent(Path=python_6)
nickname_6 = ReadSampleComponent(Path=python_7)
nickname_7 = PulseFromPointsComponent(Point=merge)
nickname_8 = PulseFromPointsComponent(Point=python_3)
nickname_9 = PulseFromPointsComponent(Point=python_4)
nickname_10 = SamplePlayerComponent(Sample=nickname_4, Points=nickname_7)
nickname_11 = SamplePlayerComponent(Sample=nickname_5, Points=nickname_8)
nickname_12 = SamplePlayerComponent(Sample=nickname_6, Points=nickname_9)
nickname_13 = MixerComponent(Wave=[nickname_11, nickname_12, nickname_10])  # -> flatten(Wave)
nickname_14 = MixerComponent(Wave=[nickname_3, nickname_13])
aout = AudioOut(Wave=nickname_14)  # -> PlayProgress, Level
nickname_15 = SampleToPolyline(Wave=nickname_14, Resolution=Slider(275, range=0..1000), PlayProgress=aout.PlayProgress)  # -> Polyline, Playhead
